test file "ETRSTests"
  coverage: Decision, MCDC, SignalRange, SimulinkDesignVerifier, RelationalBoundary, Condition, LookupTable, SignalSize, SaturationOnIntOverflow

suite "ETRS1"

  case "ETRS_1_1Chng2Park" [baseline]
    model DevChallengeETRS, stop time 35
    input "ETRSInputs.mat", mapped to ElectronicTransmissionRangeSel, ParktoChargeRequested, ElectricParkBrakeAvailable, ElectricParkBrakeApplied, Park_BrakePressed, VehicleSpeed, HVShutdownRequested, VehicleSystemEnabled (active)

  case "ETRS_1_1_1StayPark" [baseline]
    model DevChallengeETRS, mode Normal, start time 0, stop time 10

  case "ETRS_1_2Chng2Rvrs" [baseline]
    model DevChallengeETRS, mode Normal, start time 0, stop time 10
    input "ETRSInputs.mat", mapped to ElectronicTransmissionRangeSel, ParktoChargeRequested, ElectricParkBrakeAvailable, ElectricParkBrakeApplied, Park_BrakePressed, VehicleSpeed, HVShutdownRequested, VehicleSystemEnabled (active)

  case "ETRS_1_3Chng2Ntrl" [baseline]
    model DevChallengeETRS, mode Normal, start time 0, stop time 10

  case "ETRS_1_4Chng2Drv" [baseline]
    model DevChallengeETRS, mode Normal, start time 0, stop time 10

suite "ETRS2"

  case "ETRS_2_1EPB_DrvRvrs_Ntrl" [baseline]
    model DevChallengeETRS, mode Normal, start time 0, stop time 10
    input "ETRSInputs - 2.1 - 1.mat", mapped to ElectronicTransmissionRangeSel, ParktoChargeRequested, ElectricParkBrakeAvailable, ElectricParkBrakeApplied, Park_BrakePressed, VehicleSpeed, HVShutdownRequested, VehicleSystemEnabled (active)
    assessment "For Inputs 1,2": At any point of time, whenever (ElectronicTransmissionRangeSel == 2 | ElectronicTransmissionRangeSel == 4) & (ElectricParkBrakeApplied == 2 ) is true then, with a delay between 0 and 0.02, TransmissionPosition == 5 must be true
      ElectronicTransmissionRangeSel: signal DevChallengeETRS/ElectronicTransmissionRangeSel, port 1
      ElectricParkBrakeApplied: signal DevChallengeETRS/ElectricParkBrakeApplied, port 1
      TransmissionPosition: signal DevChallengeETRS/ETRS State Machine, port 1

  case "ETRS_2_2EPB_Prk_Ntrl" [baseline]
    model DevChallengeETRS, mode Normal, start time 0, stop time 10

suite "ETRS3"

  case "ETRS_3_1PrkSpd" [baseline]
    model DevChallengeETRS, mode Normal, start time 0, stop time 35
    input "ETRSInputs.mat", mapped to ElectronicTransmissionRangeSel, ParktoChargeRequested, ElectricParkBrakeAvailable, ElectricParkBrakeApplied, Park_BrakePressed, VehicleSpeed, HVShutdownRequested, VehicleSystemEnabled (active)
    assessment "Assessment1": At any point of time, whenever (VehicleSpeed < 0.5)&(ElectronicTransmissionRangeSel == 1)&(ElectricParkBrakeApplied == 1)&(ElectricParkBrakeAvailable == 1) is true then, with a delay between 0 and 0.02, ElectronicTransmissionRangeState == 0 must be true
      VehicleSpeed: signal DevChallengeETRS/VehicleSpeed, port 1
      ElectronicTransmissionRangeSel: signal DevChallengeETRS/ElectronicTransmissionRangeSel, port 1
      ElectricParkBrakeApplied: signal DevChallengeETRS/ElectricParkBrakeApplied, port 1
      ElectricParkBrakeAvailable: signal DevChallengeETRS/ElectricParkBrakeAvailable, port 1
      ElectronicTransmissionRangeState: signal DevChallengeETRS/ETRS State Machine, port 7

  case "ETRS_3_2InvldShftSpd" [baseline]
    model DevChallengeETRS, mode Normal, start time 0, stop time 10

suite "ETRS4"

  case "ETRS_4_1BrkShftPrk" [baseline]
    model DevChallengeETRS, mode Normal, start time 0, stop time 10